# Grasshopper definition calc_volume.gh (Grasshopper 1.0.7)
# plug-ins: eleFront

reflay = ReferenceByLayer(LayerName="columm", lightweight=False, DisableAutoUpdate=True)
reflay_2 = ReferenceByLayer(LayerName="pipe_line", lightweight=False, DisableAutoUpdate=True)
volume = Volume(Geometry=reflay)  # -> Volume, Centroid
midpt = CurveMiddle(Curve=reflay_2)
ef_layer = EleFrontLayer(Layer="volume_textdot", DisplayColour=ColourSwatch(SwatchColor=RGB(0, 0, 0)))  # -> Layer, FullPath, Hidden, Locked, DisplayColour, MaterialName, Linetype, PrintColour, PrintWidth
division = Division(A=volume.Volume, B="1000000000")
concat = Concatenate(FragmentA=division, FragmentB="m^3")
ef_att = EleFrontAttributes(Keys="Object_Name", Values="volume", Layer=ef_layer.Layer)  # -> Attributes, Keys, Values, Name, Layer, ColourSource, DisplayColour, MaterialSource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
textdot = DefineTextDot(Text=concat, Location=midpt, Font="Arial", Size=14)
rhinopython_bake = Boolean(True)
bake = BakeObjects(Geometry=textdot, Attributes=ef_att.Attributes, BakeName="E", Bake=rhinopython_bake, createGroups=False)  # -> Message, Guids
