# Grasshopper definition create_profile_circle.gh (Grasshopper 1.0.7)
# plug-ins: eleFront

reflay = ReferenceByLayer(LayerName="default", lightweight=False, DisableAutoUpdate=True)
cir = Circle(Plane=reflay, Radius="500")
ef_layer = EleFrontLayer(Layer="Baseline", DisplayColour=ColourSwatch(SwatchColor=RGB(4, 0, 255)))  # -> Layer, FullPath, Hidden, Locked, DisplayColour, MaterialName, Linetype, PrintColour, PrintWidth
ef_att = EleFrontAttributes(Keys="Object_Name", Values="circle", Layer=ef_layer.Layer)  # -> Attributes, Keys, Values, Name, Layer, ColourSource, DisplayColour, MaterialSource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
rhinopython_bake = Boolean()
bake = BakeObjects(Geometry=cir, Attributes=ef_att.Attributes, BakeName="A", Bake=rhinopython_bake)  # -> Message, Guids
