# Grasshopper definition create_profile_rectangle.gh (Grasshopper 1.0.7)
# plug-ins: eleFront

reflay = ReferenceByLayer(LayerName="default", lightweight=False, DisableAutoUpdate=True)
dom = ConstructDomain(DomainStart="-500", DomainEnd="500")
ef_layer = EleFrontLayer(Layer="Baseline", DisplayColour=ColourSwatch(SwatchColor=RGB(4, 0, 255)))  # -> Layer, FullPath, Hidden, Locked, DisplayColour, MaterialName, Linetype, PrintColour, PrintWidth
rectangle = Rectangle(Plane=reflay, XSize=dom, YSize=dom, Radius=0)  # -> Rectangle, Length
ef_att = EleFrontAttributes(Keys="Object_Name", Values="square", Layer=ef_layer.Layer)  # -> Attributes, Keys, Values, Name, Layer, ColourSource, DisplayColour, MaterialSource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
rhinopython_bake = Boolean()
bake = BakeObjects(Geometry=rectangle.Rectangle, Attributes=ef_att.Attributes, BakeName="B", Bake=rhinopython_bake, createGroups=False)  # -> Message, Guids
