# Grasshopper definition extrude_column.gh (Grasshopper 1.0.7)
# plug-ins: eleFront

pt = ConstructPoint(XCoordinate="0", YCoordinate="0", ZCoordinate="0")
reflay = ReferenceByLayer(LayerName="Baseline", lightweight=False, DisableAutoUpdate=True)
reflay_2 = ReferenceByLayer(LayerName="default", lightweight=False, DisableAutoUpdate=True)
ln = Line(StartPoint=reflay_2, EndPoint=pt)
len = Length(Curve=ln)
dom = ConstructDomain(DomainStart=0, DomainEnd="3000")
dom_2 = ConstructDomain(DomainStart=0, DomainEnd="16970.562748")
remap = RemapNumbers(Value=len, Source=dom_2, Target=dom)  # -> Mapped, Clipped
addition = Addition(A="4000", B=remap.Mapped)
Z = UnitZ(Factor=1)
ef_layer = EleFrontLayer(Layer="columm", DisplayColour=ColourSwatch(SwatchColor=RGB(255, 0, 0)))  # -> Layer, FullPath, Hidden, Locked, DisplayColour, MaterialName, Linetype, PrintColour, PrintWidth
ef_layer_2 = EleFrontLayer(Layer="pipe_line", DisplayColour=ColourSwatch(SwatchColor=RGB(0, 255, 64)))  # -> Layer, FullPath, Hidden, Locked, DisplayColour, MaterialName, Linetype, PrintColour, PrintWidth
line = LineSDL(Start=reflay_2, Direction=Z, Length=addition)
ef_att = EleFrontAttributes(Keys="Object_Name", Values="columm", Layer=ef_layer.Layer)  # -> Attributes, Keys, Values, Name, Layer, ColourSource, DisplayColour, MaterialSource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
ef_att_2 = EleFrontAttributes(Keys="Object_Name", Values="pipe_line", Layer=ef_layer_2.Layer)  # -> Attributes, Keys, Values, Name, Layer, ColourSource, DisplayColour, MaterialSource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
extr = Extrude(Base=reflay, Direction=line)
cap = CapHoles(Brep=extr)  # -> graft(Brep)
rhinopython_bake = Boolean()
bake = BakeObjects(Geometry=cap, Attributes=ef_att.Attributes, BakeName="C", Bake=rhinopython_bake, createGroups=False)  # -> Message, Guids
bake_2 = BakeObjects(Geometry=line, Attributes=ef_att_2.Attributes, BakeName="D", Bake=rhinopython_bake, createGroups=False)  # -> Message, Guids
